# Grasshopper definition LA3-Basic3DPSlicerGcodeGeneratorBase.gh (Grasshopper 1.0.7)

extrusion_feed_rate = Panel("600")
construct_point = ConstructPoint(XCoordinate=Slider(10, range=-10..30), YCoordinate=Slider(10, range=-10..30), ZCoordinate=Slider(1, range=-10..30))
construct_point_2 = ConstructPoint(XCoordinate=Slider(10, range=-10..30), YCoordinate=Slider(20, range=-10..30), ZCoordinate=Slider(1, range=-10..30))
construct_point_3 = ConstructPoint(XCoordinate=Slider(5, range=-10..30), YCoordinate=Slider(1, range=-10..30), ZCoordinate=Slider(0, range=-10..30))
construct_point_4 = ConstructPoint(XCoordinate=Slider(30, range=-10..30), YCoordinate=Slider(1, range=-10..30), ZCoordinate=Slider(0, range=-10..30))
line = Line(StartPoint=construct_point, EndPoint=construct_point_2)
line_2 = Line(StartPoint=construct_point_3, EndPoint=construct_point_4)
travel_feed_rate = Panel("1000")
line_3 = Line(line)
line_4 = Line(line_2)
line_5 = Line(flatten([line_4, line_3]))
ghpython_script = GhPythonScript(lines=line_5, travel_feed_rate=travel_feed_rate, extrusion_feed_rate=extrusion_feed_rate)  # -> out, gcode_output; inputs lines: list of Line
# ---------- ghpython_script: Python ----------
__author__ = "mrivera-cu"

import rhinoscriptsyntax as rs

import math


# CONSTANTS USED BELOW

# GCODE COMMANDS
COMMAND_MOVE = "G1"

# GCODE PARAM Names
PARAM_X = "X"
PARAM_Y = "Y"
PARAM_Z = "Z"
PARAM_E = "E"
PARAM_F = "F"

# Separates params in a command
PARAM_DELIMITER = " "

# Separates commands
COMMAND_DELIMITER = "\n"

# Formatter for param values
NUM_FORMAT = "{value:.3f}"

def is_equal_float(f1, f2, epsilon=0.0001):
    return math.fabs(f2 - f1) <= epsilon

# Returns true if all the coordinates are the same pt
def is_same_pt(pt1, pt2):
    return is_equal_float(pt1[0], pt2[0]) and is_equal_float(pt1[1], pt2[1]) and is_equal_float(pt1[2], pt2[2])
     
# creates a string consisting of a G1 move command and 
# any associated parameters
def gcode_move(current_pos, next_pos, feed_rate=None, shouldExtrude=False):
    params = [COMMAND_MOVE]
    # Compare X position and see if we have to move
    if (current_pos[0] != next_pos[0]):
        # we have a different x position so
        # add as a param
        x_param_value = NUM_FORMAT.format(value=next_pos[0])
        x_param_str = PARAM_X + x_param_value
        params.append(x_param_str)
    
    # Compare Y 
    if (current_pos[1] != next_pos[1]):
        # we have a different y position so
        # add as a param
        y_param_value = NUM_FORMAT.format(value=next_pos[1])
        y_param_str = PARAM_Y + y_param_value
        params.append(y_param_str)
    
    # Compare Z
    if (current_pos[2] != next_pos[2]):
        # we have a different z position so
        # add as a param
        z_param_value = NUM_FORMAT.format(value=next_pos[2])
        z_param_str = PARAM_Z + z_param_value
        params.append(z_param_str)
    
    if (feed_rate is not None):
        feed_rate_value = NUM_FORMAT.format(value=feed_rate)
        feed_rate_str = PARAM_F + feed_rate_value
        params.append(feed_rate_str)
    
    # Make the command from the parameters
    move_command = " ".join(params)
    # Remove excess whitespace on ends
    move_commnad = move_command.strip(" ")
    return move_command
    
# Here's the main procedure that uses the functions above

line = lines[0]
origin = [0, 0, 0]

gcode_lines = []

# start at the origin
last_pt = origin

# Now move to the line segments
for i in range(0, len(lines)):
    # Get pts of the line segment
    line = lines[i]
    line_start_pt = line[0]
    line_end_pt = line[1]
    
    # see if we are starting at the start point, if not
    # we need to move/travel to it
    # This case would happen when moving from the origin (last_pt = origin)
    # or if line segments are not a part of a continous curve
    if not is_same_pt(last_pt, line_start_pt):
        # first move from origin to starting point
        move_to_first_point_command = gcode_move(last_pt, line_start_pt, feed_rate=travel_feed_rate)
        # append command
        gcode_lines.append(move_to_first_point_command)
    
    # Now do the move along the line segment
    move_across_line_command = gcode_move(line_start_pt, line_end_pt, feed_rate=extrusion_feed_rate)

    # Append the move
    gcode_lines.append(move_across_line_command)
    
    # Now make the end of the line segment be the last_pt we were at
    last_pt = line_end_pt

#### WARNING: DO NOT EDIT THE START GCODE! #####
start_gcode_lines = [";START GCODE",
    "M73 P0 R42",
    "M73 Q0 S43",
    "M201 X1000 Y1000 Z200 E5000 ; sets maximum accelerations, mm/sec^2",
    "M203 X200 Y200 Z12 E120 ; sets maximum feedrates, mm / sec",
    "M204 S1250 T1250 ; sets acceleration (S) and retract acceleration (R), mm/sec^2",
    "M205 X8.00 Y8.00 Z0.40 E4.50 ; sets the jerk limits, mm/sec",
    "M205 S0 T0 ; sets the minimum extruding and travel feed rate, mm/sec",
    ";TYPE:Custom",
    "M862.3 P \"MK3S\" ; printer model check",
    "M862.1 P0.4 ; nozzle diameter check",
    "M115 U3.13.1 ; tell printer latest fw version",
    "G90 ; use absolute coordinates",
    "M83 ; extruder relative mode",
    "M104 S215 ; set extruder temp",
    "M140 S60 ; set bed temp",
    "M190 S60 ; wait for bed temp",
    "M109 S215 ; wait for extruder temp",
    "G28 W ; home all without mesh bed level",
    "G80 ; mesh bed leveling",
    "G1 Z0.2 F720",
    "G1 Y-3 F1000 ; go outside print area",
    "G92 E0",
    "G1 X60 E9 F1000 ; intro line",
    "G1 X100 E12.5 F1000 ; intro line",
    "G92 E0",
    "M221 S95",
    "; Don't change E values below. Excessive value can damage the printer.",
    "M907 E538 ; set extruder motor current",
    "G21 ; set units to millimeters",
    "G90 ; use absolute coordinates",
    "M83 ; use relative distances for extrusion",
    "M900 K0.05 ; Filament gcode LA 1.5",
    "M900 K30 ; Filament gcode LA 1.0",
    "M107"]
    
##### WARNING: DO NOT EDIT THE END GCODE! ######
end_gcode_lines = ["; END Gcode", 
    "M204 S1000", 
    "M107", 
    ";TYPE:Custom", 
    "; Filament-specific end gcode", 
    "G1 Z100 F720 ; Move print head further up", 
    "G1 X0 Y200 F3600 ; park", 
    "G4 ; wait",
    "M221 S100 ; reset flow",
    "M900 K0 ; reset LA",
    "M104 S0 ; turn off temperature",
    "M140 S0 ; turn off heatbed",
    "M107 ; turn off fan",
    "M84 ; disable motors"]
    
# Combine Lines - DO NOT EDIT
# These lines will put the start gcode before your gcode, and the end gcode
# after then merge them into the gcode output using a COMMAND_DELIMETER = “\n”
gcode_lines = start_gcode_lines + gcode_lines + end_gcode_lines
gcode_output = COMMAND_DELIMITER.join(gcode_lines)
print(gcode_output)
# ---------- end ghpython_script ----------
# NOTE THAT THIS GCODE OUTPUT ASSUMES:
# - THE USE OF PLA Material
# - Extrusion Temperature: 215C
# Heated Bed Temperature: 60C
panel = Panel(ghpython_script.gcode_output)
