# Grasshopper definition BooleanDifferenceRectMinusCircle.gh (Grasshopper 1.0.7)

# ---- group: Overlap two surfaces
xy_plane = XYPlane(Origin=Point(0, 0, 0))
unit_x = UnitX(Factor=Slider(-100, range=-100..0))
rectangle = Rectangle(Plane=xy_plane, XSize=Slider(33, range=0..100), YSize=Slider(35, range=0..100), Radius=0)  # -> Rectangle, Length
circle = Circle(Plane=xy_plane, Radius=Slider(17, range=0..100))
move = Move(Geometry=[rectangle.Rectangle, circle], Motion=unit_x)  # -> Geometry, Transform
surface = Surface(move.Geometry)

# ---- group: Boolean Difference - Remove Square from Circle
list_item = ListItem(List=surface, Index=0, Wrap=True)
list_item_2 = ListItem(List=surface, Index=Slider(1, range=0..1), Wrap=True)
solid_difference = SolidDifference(BrepsA=list_item, BrepsB=list_item_2)
surface_2 = Surface(solid_difference)
list_item_3 = ListItem(List=surface_2, Index=Slider(0, range=0..1), Wrap=True)
