# Grasshopper definition CullingFromAListOfNumbers.gh (Grasshopper 1.0.7)

# ---- group: Culling Items from a List
series = Series(Start=Slider(0, range=0..100), Step=Slider(3, range=0..100), Count=Slider(100, range=0..100))
panel = Panel(series)
modulus = Modulus(A=panel, B=Slider(2, range=0..10))

# ----
boolean = Boolean(modulus)

# ---- group: Culling Items from a List (continued)
cull_pattern = CullPattern(List=panel, CullPattern=boolean)
panel_2 = Panel(boolean)

# ----
number = Number(cull_pattern)

# ---- group: Culling Items from a List (continued)
panel_3 = Panel(number)
