# Grasshopper definition DivideCurvesAndExtrudePerpendicular.gh (Grasshopper 1.0.7)

curve_internalized_input_curve = Curve(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)

# ---- group: Divide Curve into 50 Points
divide_curve = DivideCurve(Curve=curve_internalized_input_curve, Count=Slider(50, range=0..100), Kinks=False)  # -> Points, Tangents, Parameters

# ---- group: Extrude to Breps Along Z-Dir
unit_z = UnitZ(Factor=1)
extrude = Extrude(Base=curve_internalized_input_curve, Direction=unit_z)
brep = Brep(extrude)

# ---- group: Get Perpendicular Vector from Tangents at Point with Y-Dir
unit_y = UnitY(Factor=1)
cross_product = CrossProduct(VectorA=divide_curve.Tangents, VectorB=unit_y, Unitize=False)  # -> Vector, Length
addition = Addition(A=divide_curve.Points, B=cross_product.Vector)
line = Line(StartPoint=divide_curve.Points, EndPoint=addition)

# ---- group: Extrude Perpendicular BReps From PolyLine
polyline = PolyLine(Vertices=divide_curve.Points, Closed=False)
extrude_2 = Extrude(Base=polyline, Direction=line)
move = Move(Geometry=extrude_2, Motion=Vector(0, 0, 10))  # -> Geometry, Transform
brep_2 = Brep(move.Geometry)
