# Grasshopper definition DivideInputCurveAndMoveSinglePoint.gh (Grasshopper 1.0.7)

input_curve_internalized_data = Curve(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)

# ---- group: Divide Input Curve into 50 Points
divide_curve = DivideCurve(Curve=input_curve_internalized_data, Count=Slider(50, range=0..100), Kinks=False)  # -> Points, Tangents, Parameters

# ---- group: Move A Single Point On Input Curve
number_slider = Slider(7, range=0..100)
list_item = ListItem(List=divide_curve.Points, Index=number_slider, Wrap=True)
move = Move(Geometry=list_item, Motion=Vector(0, 0, 10))  # -> Geometry, Transform
replace_items = ReplaceItems(List=divide_curve.Points, Item=move.Geometry, Indices=number_slider, Wrap=False)
polyline = PolyLine(Vertices=replace_items, Closed=False)

# ---- group: Extrude PolyLine
curve = Curve(polyline)
unit_z = UnitZ(Factor=Slider(9, range=0..100))
extrude = Extrude(Base=curve, Direction=unit_z)
brep = Brep(extrude)
