# Grasshopper definition GHBooleanOperations.gh (Grasshopper 1.0.8)

xy_plane = XYPlane(Origin=Point(0, 0, 0))

# ---- group: Make the Base Circle
unit_y = UnitY(Factor=Slider(10, range=0..20))
circle = Circle(Plane=xy_plane, Radius=Slider(10, range=0..20))
move = Move(Geometry=circle, Motion=unit_y)  # -> Geometry, Transform

# ---- group: Make the Base Rectangle
# Set-up Circle and Rect
number_slider = Slider(20, range=0..20)
rectangle = Rectangle(Plane=xy_plane, XSize=number_slider, YSize=number_slider, Radius=0)  # -> Rectangle, Length
unit_x = UnitX(Factor=Slider(-20, range=-20..20))
move_2 = Move(Geometry=rectangle.Rectangle, Motion=unit_x)  # -> Geometry, Transform

# ---- group: Create Surfaces from Curves
surface = Surface(move_2.Geometry)
surface_2 = Surface(move.Geometry)

# ---- group: Move 50 on X
unit_x_2 = UnitX(Factor=50)
move_3 = Move(Geometry=surface_2, Motion=unit_x_2)  # -> Geometry, Transform

unit_x_3 = UnitX(Factor=50)
move_4 = Move(Geometry=surface, Motion=unit_x_3)  # -> Geometry, Transform

# ---- group: Extrude Surfaces to Volumes
unit_z = UnitZ(Factor=1)
extrude = Extrude(Base=move_4.Geometry, Direction=unit_z)
extrude_2 = Extrude(Base=move_3.Geometry, Direction=unit_z)

# ----
# BOOLEAN OPERATIONS
xy_plane_2 = XYPlane(Origin=Point(0, 0, 0))
# Region Operations (Curves)
# UNION
curve = Curve([move_2.Geometry, move.Geometry])
region_union = RegionUnion(Curves=curve, Plane=xy_plane_2)

# ----
# Solid Operations (BREPS, with thickness)
xy_plane_3 = XYPlane(Origin=Point(0, 0, 0))
region_intersection = RegionIntersection(CurvesA=move_2.Geometry, CurvesB=move.Geometry, Plane=xy_plane_3)

# ----
# DIFFERENCE
# INTERSECTION
xy_plane_4 = XYPlane(Origin=Point(0, 0, 0))
region_difference = RegionDifference(CurvesA=move_2.Geometry, CurvesB=move.Geometry, Plane=xy_plane_4)

# ---- group: Solid UNION
# UNION
# DIFFERENCE
brep = Brep([extrude_2, extrude])
solid_union = SolidUnion(Breps=brep)

# ---- group: Solid INTERSECTION
# INTERSECTION
solid_intersection = SolidIntersection(BrepsA=extrude, BrepsB=extrude_2)

# ---- group: Solid DIFFERENCE
solid_difference = SolidDifference(BrepsA=extrude, BrepsB=extrude_2)

# ---- group: MOVE -25 IN Y
unit_y_2 = UnitY(Factor=-25)
move_5 = Move(Geometry=solid_difference, Motion=unit_y_2)  # -> Geometry, Transform

# ---- group: MOVE -50 IN Y
unit_y_3 = UnitY(Factor=-50)
move_6 = Move(Geometry=solid_intersection, Motion=unit_y_3)  # -> Geometry, Transform

# ---- group: Final Union BRep
brep_2 = Brep(solid_union)

# ---- group: MOVE -25 IN Y
unit_y_4 = UnitY(Factor=-25)
move_7 = Move(Geometry=region_difference, Motion=unit_y_4)  # -> Geometry, Transform

# ---- group: MOVE -50 IN Y
unit_y_5 = UnitY(Factor=-50)
move_8 = Move(Geometry=region_intersection, Motion=unit_y_5)  # -> Geometry, Transform

# ---- group: Final Union BRep
curve_2 = Curve(region_union)
