# Grasshopper definition GHEntwineUnionCylinders.gh (Grasshopper 1.0.8)

number_slider = Slider(40, range=0..100)

# ---- group: Create a circle
# Create a Circle
xz_plane = XZPlane(Origin=Point(0, 0, 0))
circle = Circle(Plane=xz_plane, Radius=Slider(24, range=0..1000))
# Bunch of really interesting notes
surface = Surface(circle)

# ----
number_slider_2 = Slider(0.307, range=0..1)
unit_y = UnitY(Factor=Slider(0.01, range=0.01..20))
number_slider_3 = Slider(34.3, range=0..1000)
number_slider_4 = Slider(18, range=1..50)
extrude = Extrude(Base=circle, Direction=unit_y)
extrude_2 = Extrude(Base=surface, Direction=unit_y)
yz_plane = YZPlane(Origin=Point(0, 0, 0))
vector_xyz = VectorXYZ(XComponent=Slider(34, range=0..100), YComponent=0, ZComponent=0)  # -> Vector, Length
construct_point = ConstructPoint(XCoordinate="10", YCoordinate=number_slider_2, ZCoordinate=number_slider_2)
number_slider_5 = Slider(668.8, range=0..1000)
vector_xyz_2 = VectorXYZ(XComponent=number_slider_3, YComponent=number_slider_3, ZComponent=number_slider_3)  # -> Vector, Length
rectangle = Rectangle(Plane=yz_plane, XSize=number_slider_4, YSize=number_slider_4, Radius=Slider(5, range=1..10))  # -> Rectangle, Length
move = Move(Geometry=extrude, Motion=vector_xyz.Vector)  # -> Geometry, Transform
point = Point(construct_point)
panel = Panel(construct_point)
panel_2 = Panel(vector_xyz_2.Vector)
addition = Addition(FirstPt=construct_point, B=vector_xyz_2.Vector)
cap_holes = CapHoles(Brep=move.Geometry)
unit_x = UnitX(Factor=Slider(100, range=0..100))
surface_2 = Surface(rectangle.Rectangle)
line = Line(StartPoint=construct_point, EndPoint=addition)
extrude_3 = Extrude(Base=surface_2, Direction=unit_x)
unit_x_2 = UnitX(Factor=Slider(40, range=1..1000))

entwine = Entwine(Branch00=extrude_2, Branch01=cap_holes, FlattenInputs=True)
param_viewer = ParamViewer(entwine)
solid_union = SolidUnion(Breps=entwine)
panel_3 = Panel(entwine)

extrude_4 = Extrude(Base=line, Direction=unit_x_2)
geometry = Geometry(extrude_4)
unit_z = UnitZ(Factor=Slider(75.25, range=1..1000))
area = Area(Geometry=geometry)  # -> Area, Centroid
area_2 = Area(Geometry=extrude_4)  # -> Area, Centroid
vector_xyz_3 = VectorXYZ(XComponent=0, YComponent=0, ZComponent=0)  # -> Vector, Length
evaluate_surface = EvaluateSurface(Surface=geometry, Point=area.Centroid)  # -> Point, Normal, UDirection, VDirection, Frame
extrude_5 = Extrude(Base=extrude_4, Direction=unit_z)
evaluate_surface_2 = EvaluateSurface(Surface=extrude_4, Point=area_2.Centroid)  # -> Point, Normal, UDirection, VDirection, Frame
number_slider_6 = Slider(16.6, range=0..100)
panel_4 = Panel(unit_z)
multiplication = Multiplication(A=Slider(52, range=1..150), B=evaluate_surface.Normal)
vector_display = VectorDisplay(Anchor=area_2.Centroid, Vector=evaluate_surface_2.Normal)
multiplication_2 = Multiplication(A=evaluate_surface_2.Normal, B=number_slider_6)
vector_display_2 = VectorDisplay(Anchor=area.Centroid, Vector=evaluate_surface.Normal)
vector_display_3 = VectorDisplay(Anchor=area.Centroid, Vector=multiplication)
extrude_6 = Extrude(Base=extrude_4, Direction=multiplication_2)
multiplication_3 = Multiplication(A=multiplication_2, B=number_slider_6)
extrude_7 = Extrude(Base=geometry, Direction=multiplication)
extrude_8 = Extrude(Base=extrude_6, Direction=multiplication_3)
entwine_2 = Entwine(Branch00=extrude_8, Branch01=extrude_3, FlattenInputs=True)  # -> flatten(Result)
solid_union_2 = SolidUnion(Breps=entwine_2)
