# Grasshopper definition GHExtrudeCircle.gh (Grasshopper 1.0.8)

construct_point = ConstructPoint(XCoordinate=0, YCoordinate=0, ZCoordinate=0)
xz_plane = XZPlane(Origin=construct_point)
circle = Circle(Plane=xz_plane, Radius=Slider(11, range=0..70))
unit_y = UnitY(Factor=Slider(40, range=0..40))
extrude = Extrude(Base=circle, Direction=unit_y)
