# Grasshopper definition GHLoftRandomSeriesPoints.gh (Grasshopper 1.0.8)

number_slider = Slider(5, range=1..5)
random = Random(Range=Domain(0, 1), Number=number_slider, Seed=Slider(32, range=0..100))
series = Series(Start=0, Step=Slider(7, range=1..20), Count=number_slider)
number_slider_2 = Slider(5, range=0..10)
multiplication = Multiplication(A=random, B=Slider(24, range=0..100))
panel = Panel(series)
random_2 = Random(Range=Domain(0, 1), Number=number_slider_2, Seed=2)
construct_point = ConstructPoint(XCoordinate=Slider(16, range=0..100), YCoordinate=multiplication, ZCoordinate=series)
series_2 = Series(Start=0, Step=Slider(10, range=0..10), Count=number_slider_2)
multiplication_2 = Multiplication(A=Slider(5, range=0..100), B=random_2)
xy_plane = XYPlane(Origin=construct_point)
panel_2 = Panel(construct_point)
construct_point_2 = ConstructPoint(XCoordinate=multiplication_2, YCoordinate=0, ZCoordinate=series_2)
series_3 = Series(Start=Slider(3, range=0..10), Step=1, Count=number_slider)
series_4 = Series(Start=Slider(4, range=1..30), Step=1, Count=number_slider)
panel_3 = Panel(series_2)
panel_4 = Panel(construct_point_2)
xy_plane_2 = XYPlane(Origin=construct_point_2)
panel_5 = Panel(series_3)
polygon = Polygon(Plane=xy_plane, Radius=series_4, Segments=series_3, FilletRadius=0)  # -> Polygon, Length
series_5 = Series(Start=Slider(3, range=0..10), Step=Slider(1, range=0..10), Count=number_slider_2)
loft = Loft(Curves=polygon.Polygon, Options={Adjust=False, Closed=False, LoftEnds=0, LoftSimp=0, LoftType=0, Rebuild=10, Refit=0.01})
polygon_2 = Polygon(Plane=xy_plane_2, Radius=Slider(5, range=0..20), Segments=series_5, FilletRadius=0)  # -> Polygon, Length
cap_holes = CapHoles(Brep=loft)
loft_2 = Loft(
    Curves=polygon_2.Polygon,
    Options={Adjust=False, Closed=False, LoftEnds=0, LoftSimp=0, LoftType=0, Rebuild=10, Refit=0.01})
cap_holes_2 = CapHoles(Brep=loft_2)
