# Grasshopper definition GHLoftingRects.gh (Grasshopper 1.0.8)

# ---- group: Top Rect
unit_z = UnitZ(Factor=Slider(59, range=0..100))
xy_plane = XYPlane(Origin=unit_z)
rectangle = Rectangle(Plane=xy_plane, XSize=Slider(61, range=0..100), YSize=Slider(21, range=0..100), Radius=Slider(0, range=0..100))  # -> Rectangle, Length

# ---- group: Middle Rect
unit_z_2 = UnitZ(Factor=Slider(20, range=0..20))
xy_plane_2 = XYPlane(Origin=unit_z_2)
rectangle_2 = Rectangle(Plane=xy_plane_2, XSize=Slider(53, range=0..100), YSize=Slider(32, range=0..100), Radius=Slider(38, range=0..100))  # -> Rectangle, Length

# ---- group: Bottom Rect
xy_plane_3 = XYPlane(Origin=Point(0, 0, 0))
rectangle_3 = Rectangle(Plane=xy_plane_3, XSize=Slider(72, range=0..100), YSize=Slider(21, range=0..100), Radius=Slider(0, range=0..100))  # -> Rectangle, Length

# ----
merge = Merge(Data1=rectangle.Rectangle, Data2=rectangle_2.Rectangle, Data3=rectangle_3.Rectangle)

# ---- group: Loft Geometry
geometry = Geometry([rectangle.Rectangle, rectangle_2.Rectangle, rectangle_3.Rectangle])
loft = Loft(Curves=merge, Options={Adjust=False, Closed=False, LoftEnds=0, LoftSimp=0, LoftType=0, Rebuild=10, Refit=0.01})

# ----
panel = Panel(merge)
cap_holes = CapHoles(Brep=loft)
geometry_2 = Geometry(cap_holes)
bounding_box = BoundingBox(Content=geometry_2, Plane=PlaneXY(0, 0, 0))  # -> Box, Box_2
deconstruct_box = DeconstructBox(Box=bounding_box.Box)  # -> Plane, X, Y, Z
volume = Volume(Geometry=geometry_2)  # -> Volume, Centroid
deconstruct_domain = DeconstructDomain(Domain=deconstruct_box.X)  # -> Start, End
deconstruct_domain_2 = DeconstructDomain(Domain=deconstruct_box.Z)  # -> Start, End
deconstruct = Deconstruct(Point=volume.Centroid)  # -> XComponent, YComponent, ZComponent
top_point = ConstructPoint(XCoordinate=deconstruct_domain.End, YCoordinate=deconstruct.YComponent, ZCoordinate=deconstruct.ZComponent)
bottom_point = ConstructPoint(XCoordinate=deconstruct_domain.Start, YCoordinate=deconstruct.YComponent, ZCoordinate=deconstruct.ZComponent)
line = Line(StartPoint=top_point, EndPoint=bottom_point)
twist = Twist(Geometry=geometry_2, Axis=line, Angle=Slider(38.7, range=1.571..157.08), Infinite=False, Rigid=False)
