# Grasshopper definition GHPointToBoxAndCylinderTwist.gh (Grasshopper 1.0.8)

# ---- group: Make Fancy Line
number_slider = Slider(12, range=0..100)
number_slider_2 = Slider(11, range=0..50)
# 1. Making a Box (from Point to Line to Surface Rect)
number_slider_3 = Slider(0, range=0..100)
vector_xyz = VectorXYZ(XComponent=number_slider_2, YComponent=number_slider_2, ZComponent=0)  # -> Vector, Length
construct_point = ConstructPoint(XCoordinate=number_slider, YCoordinate=number_slider, ZCoordinate=number_slider)
vector_display = VectorDisplay(Anchor=construct_point, Vector=vector_xyz.Vector)
addition = Addition(A=construct_point, B=vector_xyz.Vector)
point_end_of_line = Point(addition)
line = Line(StartPoint=construct_point, EndPoint=point_end_of_line)

# ----
# Create Circle
number_slider_4 = Slider(10.3, range=0..100)
# 2. Making a Cylinder using Extrude and CapHoles
xz_plane = XZPlane(Origin=Point(0, 0, 0))
circle = Circle(Plane=xz_plane, Radius=number_slider_4)

# ---- group: Direction + Amount to Extrude By
unit_y = UnitY(Factor=Slider(24, range=0..100))

# ----
# Make Cylinder from Surface + Extrude
surface = Surface(circle)
extrude = Extrude(Base=surface, Direction=unit_y)

# ----
# Make Cylinder by CapHoles
extrude_2 = Extrude(Base=circle, Direction=unit_y)
cap_holes = CapHoles(Brep=extrude_2)

# ---- group: Make a rectangular surface
# Extrude Rect Surface
number_slider_5 = Slider(10.5, range=0..25)
unit_z = UnitZ(Factor=number_slider_5)
extrude_3 = Extrude(Base=line, Direction=unit_z)

# ----
# Visualize the Centroid
area = Area(Geometry=extrude)  # -> Area, Centroid
volume = Volume(Geometry=extrude)  # -> Volume, Centroid

# ----
# Extrude a Box from the the Surface
number_slider_6 = Slider(5, range=0..5)
negative = Negative(Value=number_slider_6)
vector_xyz_2 = VectorXYZ(XComponent=negative, YComponent=Slider(5, range=0..5), ZComponent=0)  # -> Vector, Length
extrude_4 = Extrude(Base=extrude_3, Direction=vector_xyz_2.Vector)
brep = Brep(extrude_4)

# ---- group: Show Vector
construct_point_2 = ConstructPoint(XCoordinate=0, YCoordinate=0, ZCoordinate=0)
vector_display_2 = VectorDisplay(Anchor=construct_point_2, Vector=vector_xyz_2.Vector)

# ----
panel = Panel(vector_xyz_2.Vector)

# ---- group: Twist the Box
bounding_box = BoundingBox(Content=brep, Plane=PlaneXY(0, 0, 0))  # -> Box, Box_2
volume_2 = Volume(Geometry=brep)  # -> Volume, Centroid
deconstruct_box = DeconstructBox(Box=bounding_box.Box)  # -> Plane, X, Y, Z
deconstruct = Deconstruct(Point=volume_2.Centroid)  # -> XComponent, YComponent, ZComponent
deconstruct_domain = DeconstructDomain(Domain=deconstruct_box.Z)  # -> Start, End
construct_point_bottom = ConstructPoint(XCoordinate=deconstruct.XComponent, YCoordinate=deconstruct.YComponent, ZCoordinate=deconstruct_domain.Start)
construct_point_top = ConstructPoint(XCoordinate=deconstruct.XComponent, YCoordinate=deconstruct.YComponent, ZCoordinate=deconstruct_domain.End)
line_2 = Line(StartPoint=construct_point_bottom, EndPoint=construct_point_top)
twist = Twist(Geometry=brep, Axis=line_2, Angle=Slider(5.184, range=0..18.85), Infinite=False, Rigid=False)

# ----
panel_2 = Panel(deconstruct_box.X)
unit_z_2 = UnitZ(Factor=deconstruct_domain.Start)
brep_2 = Brep(twist)
negative_2 = Negative(Value=unit_z_2)
move = Move(Geometry=brep_2, Motion=negative_2)  # -> Geometry, Transform
area_2 = Area(Geometry=move.Geometry)  # -> Area, Centroid
distance = Distance(PointA=area_2.Centroid, PointB=volume_2.Centroid)
