# Grasshopper definition GHPointToSurface.gh (Grasshopper 1.0.8)

number_slider = Slider(0.307, range=0..1)
number_slider_2 = Slider(34.3, range=0..1000)
construct_point = ConstructPoint(XCoordinate="10", YCoordinate=number_slider, ZCoordinate=number_slider)
number_slider_3 = Slider(668.8, range=0..1000)
vector_xyz = VectorXYZ(XComponent=number_slider_2, YComponent=number_slider_2, ZComponent=number_slider_2)  # -> Vector, Length
point = Point(construct_point)
panel = Panel(construct_point)
panel_2 = Panel(vector_xyz.Vector)
addition = Addition(FirstPt=construct_point, B=vector_xyz.Vector)
line = Line(StartPoint=construct_point, EndPoint=addition)
unit_x = UnitX(Factor=Slider(40, range=1..1000))
extrude = Extrude(Base=line, Direction=unit_x)
geometry = Geometry(extrude)
area = Area(Geometry=geometry)  # -> Area, Centroid
evaluate_surface = EvaluateSurface(Surface=geometry, Point=area.Centroid)  # -> Point, Normal, UDirection, VDirection, Frame
multiplication = Multiplication(A=Slider(52, range=1..150), B=evaluate_surface.Normal)
vector_display = VectorDisplay(Anchor=area.Centroid, Vector=evaluate_surface.Normal)
vector_display_2 = VectorDisplay(Anchor=area.Centroid, Vector=multiplication)
extrude_2 = Extrude(Base=geometry, Direction=multiplication)
