# Grasshopper definition GHPointsToLoft.gh (Grasshopper 1.0.7)

vector_xyz = VectorXYZ(XComponent=0, YComponent=Slider(10, range=0..30), ZComponent=0)  # -> Vector, Length
construct_point = ConstructPoint(XCoordinate=0, YCoordinate=0, ZCoordinate=Slider(0, range=0..100))
panel = Panel(vector_xyz.Vector)
number_slider = Slider(10, range=0..10)
addition = Addition(A=construct_point, B=vector_xyz.Vector)
construct_point_2 = ConstructPoint(XCoordinate=Slider(10, range=0..10), YCoordinate=0, ZCoordinate=0)
construct_point_3 = ConstructPoint(XCoordinate=number_slider, YCoordinate=number_slider, ZCoordinate=0)
point = Point(addition)
panel_2 = Panel(addition)
line = Line(StartPoint=construct_point, EndPoint=point)
point_2 = Point([construct_point, point, construct_point_3, construct_point_2])
panel_3 = Panel(point_2)
polyline = PolyLine(Vertices=point_2, Closed=Toggle(True))
unit_z = UnitZ(Factor=Slider(12, range=0..100))
surface = Surface(polyline)
panel_4 = Panel(unit_z)
unit_z_2 = UnitZ(Factor=Slider(48, range=0..100))
extrude = Extrude(Base=surface, Direction=unit_z)
move = Move(Geometry=polyline, Motion=unit_z_2)  # -> Geometry, Transform
area = Area(Geometry=move.Geometry)  # -> Area, Centroid
scale = Scale(Geometry=move.Geometry, Center=area.Centroid, Factor=Slider(3, range=0..100))  # -> Geometry, Transform
surface_2 = Surface(scale.Geometry)
loft = Loft(
    Curves=[scale.Geometry, polyline],
    Options={Adjust=False, Closed=False, LoftEnds=0, LoftSimp=0, LoftType=0, Rebuild=10, Refit=0.01})
