# Grasshopper definition GHRandomCirclesLoft.gh (Grasshopper 1.0.8)

num_circles = Slider(13, range=1..20)
construct_domain = ConstructDomain(DomainStart=Slider(9, range=0..10), DomainEnd=Slider(20, range=0..100))
random = Random(Range=construct_domain, Number=num_circles, Seed=Slider(4100.1, range=0.1..10000))
series = Series(Start=0, Step=Slider(2, range=0..5), Count=num_circles)
series_2 = Series(Start=Slider(3, range=0..100), Step=Slider(1, range=0..1), Count=num_circles)
panel = Panel(series_2)
panel_2 = Panel(random)
construct_point = ConstructPoint(XCoordinate=0, YCoordinate=0, ZCoordinate=series)
xy_plane = XYPlane(Origin=construct_point)
circle = Circle(Plane=xy_plane, Radius=random)
loft = Loft(Curves=circle, Options={Adjust=False, Closed=False, LoftEnds=0, LoftSimp=0, LoftType=0, Rebuild=10, Refit=0.01})
panel_3 = Panel(circle)
