# Grasshopper definition GHSurfaceNormalExtrude.gh (Grasshopper 1.0.8)

number_slider = Slider(0.307, range=0..1)
number_slider_2 = Slider(34.3, range=0..1000)
number_slider_3 = Slider(18, range=1..50)
yz_plane = YZPlane(Origin=Point(0, 0, 0))
construct_point = ConstructPoint(XCoordinate="10", YCoordinate=number_slider, ZCoordinate=number_slider)
number_slider_4 = Slider(668.8, range=0..1000)
vector_xyz = VectorXYZ(XComponent=number_slider_2, YComponent=number_slider_2, ZComponent=number_slider_2)  # -> Vector, Length
rectangle = Rectangle(Plane=yz_plane, XSize=number_slider_3, YSize=number_slider_3, Radius=Slider(5, range=1..10))  # -> Rectangle, Length
point = Point(construct_point)
panel = Panel(construct_point)
panel_2 = Panel(vector_xyz.Vector)
addition = Addition(FirstPt=construct_point, B=vector_xyz.Vector)
unit_x = UnitX(Factor=Slider(100, range=0..100))
surface = Surface(rectangle.Rectangle)
line = Line(StartPoint=construct_point, EndPoint=addition)
extrude = Extrude(Base=surface, Direction=unit_x)
unit_x_2 = UnitX(Factor=Slider(40, range=1..1000))
extrude_2 = Extrude(Base=line, Direction=unit_x_2)
geometry = Geometry(extrude_2)
unit_z = UnitZ(Factor=Slider(75.25, range=1..1000))
area = Area(Geometry=geometry)  # -> Area, Centroid
area_2 = Area(Geometry=extrude_2)  # -> Area, Centroid
vector_xyz_2 = VectorXYZ(XComponent=0, YComponent=0, ZComponent=0)  # -> Vector, Length
evaluate_surface = EvaluateSurface(Surface=geometry, Point=area.Centroid)  # -> Point, Normal, UDirection, VDirection, Frame
extrude_3 = Extrude(Base=extrude_2, Direction=unit_z)
evaluate_surface_2 = EvaluateSurface(Surface=extrude_2, Point=area_2.Centroid)  # -> Point, Normal, UDirection, VDirection, Frame
panel_3 = Panel(unit_z)
multiplication = Multiplication(A=Slider(52, range=1..150), B=evaluate_surface.Normal)
vector_display = VectorDisplay(Anchor=area_2.Centroid, Vector=evaluate_surface_2.Normal)
multiplication_2 = Multiplication(A=evaluate_surface_2.Normal, B=Slider(16.6, range=0..100))
vector_display_2 = VectorDisplay(Anchor=area.Centroid, Vector=evaluate_surface.Normal)
vector_display_3 = VectorDisplay(Anchor=area.Centroid, Vector=multiplication)
extrude_4 = Extrude(Base=extrude_2, Direction=multiplication_2)
extrude_5 = Extrude(Base=geometry, Direction=multiplication)
