# Grasshopper definition GHTwistRectsBBox.gh (Grasshopper 1.0.7)

number_slider = Slider(5, range=0..10)
number_slider_2 = Slider(6, range=0..10)
series = Series(Start=0, Step=number_slider, Count=number_slider_2)
unit_z = UnitZ(Factor=series)
panel = Panel(series)
point = Point(unit_z)
panel_2 = Panel(unit_z)
series_2 = Series(Start=Slider(10, range=10..100), Step=Slider(6, range=0..15), Count=number_slider_2)
xy_plane = XYPlane(Origin=point)
rectangle = Rectangle(Plane=xy_plane, XSize=Domain(-1, 1), YSize=series_2, Radius=0)  # -> Rectangle, Length
unit_z_2 = UnitZ(Factor=number_slider)
surface = Surface(rectangle.Rectangle)
extrude = Extrude(Base=surface, Direction=unit_z_2)
solid_union = SolidUnion(Breps=extrude)
geometry = Geometry(solid_union)
bounding_box = BoundingBox(Content=solid_union, Plane=PlaneXY(0, 0, 0))  # -> Box, Box_2
area = Area(Geometry=solid_union)  # -> Area, Centroid
deconstruct_box = DeconstructBox(Box=bounding_box.Box)  # -> Plane, X, Y, Z
deconstruct = Deconstruct(Point=area.Centroid)  # -> XComponent, YComponent, ZComponent
panel_3 = Panel(deconstruct_box.Z)
deconstruct_domain = DeconstructDomain(Domain=deconstruct_box.Z)  # -> Start, End
construct_point = ConstructPoint(XCoordinate=deconstruct.XComponent, YCoordinate=deconstruct.YComponent, ZCoordinate=deconstruct_domain.Start)
construct_point_2 = ConstructPoint(XCoordinate=deconstruct.XComponent, YCoordinate=deconstruct.YComponent, ZCoordinate=deconstruct_domain.End)
line = Line(StartPoint=construct_point, EndPoint=construct_point_2)
deconstruct_box_2 = DeconstructBox()  # -> Plane, X, Y, Z
twist = Twist(Geometry=geometry, Axis=line, Angle=Slider(4.771, range=0..18.85), Infinite=False, Rigid=False)
vector_xyz = VectorXYZ(XComponent=Slider(30, range=0..40), YComponent=Slider(25, range=0..40), ZComponent=Slider(17, range=0..40))  # -> Vector, Length
unit_y = UnitY(Factor=Slider(50, range=0..50))
deconstruct_2 = Deconstruct()  # -> XComponent, YComponent, ZComponent
panel_4 = Panel(vector_xyz.Vector)
move = Move(Geometry=line, Motion=unit_y)  # -> Geometry, Transform
move_2 = Move(Geometry=twist, Motion=vector_xyz.Vector)  # -> Geometry, Transform
deconstruct_domain_2 = DeconstructDomain(Domain=deconstruct_box_2.Z)  # -> Start, End
rotate_axis = RotateAxis(Geometry=twist, Angle=Slider(11.545, range=0..18.85), Axis=move.Geometry)  # -> Geometry, Transform
number = Number([deconstruct_domain_2.Start, deconstruct_domain_2.End])
construct_point_3 = ConstructPoint(XCoordinate=deconstruct_2.XComponent, YCoordinate=deconstruct_2.YComponent, ZCoordinate=number)
list_item = ListItem(List=construct_point_3, Index="1", Wrap=True)
list_item_2 = ListItem(List=construct_point_3, Index="0", Wrap=True)
line_2 = Line(StartPoint=list_item_2, EndPoint=list_item)
relay = Relay()
twist_2 = Twist(Geometry=relay, Axis=line_2, Angle=Slider(7.02, range=0..18.85), Infinite=False, Rigid=False)
