# Grasshopper definition GHTwistingRects.gh (Grasshopper 1.0.7)

# ---- group: Top Rect
unit_z = UnitZ(Factor=Slider(37, range=0..100))
xy_plane = XYPlane(Origin=unit_z)
rectangle = Rectangle(Plane=xy_plane, XSize=Slider(8, range=0..100), YSize=Slider(51, range=0..100), Radius=Slider(0, range=0..100))  # -> Rectangle, Length

# ---- group: Middle Rect
number_slider = Slider(2, range=0..20)
unit_z_2 = UnitZ(Factor=Slider(8, range=0..20))
xy_plane_2 = XYPlane(Origin=unit_z_2)
rectangle_2 = Rectangle(Plane=xy_plane_2, XSize=Slider(52, range=0..100), YSize=Slider(60, range=0..100), Radius=Slider(7, range=0..100))  # -> Rectangle, Length

# ---- group: Bottom Rect
xy_plane_3 = XYPlane(Origin=Point(0, 0, 0))
rectangle_3 = Rectangle(Plane=xy_plane_3, XSize=Slider(72, range=0..100), YSize=Slider(72, range=0..100), Radius=Slider(15, range=0..100))  # -> Rectangle, Length

# ----
geometry = Geometry([rectangle_3.Rectangle, rectangle_2.Rectangle, rectangle.Rectangle])

# ---- group: Loft Geometry
geometry_2 = Geometry([rectangle.Rectangle, rectangle_2.Rectangle, rectangle_3.Rectangle])
loft = Loft(Curves=geometry_2, Options={Adjust=False, Closed=False, LoftEnds=0, LoftSimp=0, LoftType=0, Rebuild=10, Refit=0.01})

# ----
brep = Brep(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)
brep_2 = Brep(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)
cap_holes = CapHoles(Brep=[brep, brep_2])
solid_union = SolidUnion(Breps=cap_holes)

bounding_box = BoundingBox(Content=solid_union, Plane=PlaneXY(0, 0, 0))  # -> Box, Box_2
deconstruct_box = DeconstructBox(Box=bounding_box.Box)  # -> Plane, X, Y, Z
deconstruct_domain = DeconstructDomain(Domain=deconstruct_box.Z)  # -> Start, End

area = Area(Geometry=solid_union)  # -> Area, Centroid
deconstruct = Deconstruct(Point=area.Centroid)  # -> XComponent, YComponent, ZComponent
construct_point = ConstructPoint(XCoordinate=deconstruct.XComponent, YCoordinate=deconstruct.YComponent, ZCoordinate=deconstruct_domain.End)
construct_point_2 = ConstructPoint(XCoordinate=deconstruct.XComponent, YCoordinate=deconstruct.YComponent, ZCoordinate=deconstruct_domain.Start)
line = Line(StartPoint=construct_point_2, EndPoint=construct_point)

twist = Twist(Geometry=solid_union, Axis=line, Angle=Slider(13, range=0..720), Infinite=Toggle(False), Rigid=False)
