# Grasshopper definition LoftingRects.gh (Grasshopper 1.0.7)

Z = UnitZ(Factor=Slider(17, range=0..20))
Z_2 = UnitZ(Factor=Slider(7, range=0..20))
xy = XYPlane(Origin=Z)
number_slider = Slider(0, range=0..20)
xy_2 = XYPlane(Origin=Z_2)
xy_3 = XYPlane(Origin=Point(0, 0, 0))
rectangle = Rectangle(Plane=xy_2, XSize=Slider(34, range=0..100), YSize=Slider(26, range=0..100), Radius=Slider(0, range=0..100))  # -> Rectangle, Length
rectangle_2 = Rectangle(Plane=xy, XSize=Slider(57, range=0..100), YSize=Slider(41, range=0..100), Radius=Slider(5, range=0..100))  # -> Rectangle, Length
rectangle_3 = Rectangle(Plane=xy_3, XSize=Slider(43, range=0..100), YSize=Slider(55, range=0..100), Radius=Slider(0, range=0..100))  # -> Rectangle, Length
loft = Loft(
    Curves=[rectangle_2.Rectangle, rectangle.Rectangle, rectangle_3.Rectangle],
    Options={Adjust=False, Closed=False, LoftEnds=0, LoftSimp=0, LoftType=0, Rebuild=10, Refit=0.01})
mesh = Mesh()
cap = CapHoles(Brep=loft)
mesh_2 = MeshBrep(
    Brep=cap,
    Settings={GridMaxCount=0, GridMinCount=16, JaggedSeams=False, MaxEdgeLength=0, MinEdgeLength=0.0001, MinTolerance=0, Refine=True, RefineAngle=0, RelativeTolerance=0.65, SimplePlanes=True, Tolerance=0})
