# Grasshopper definition PointsAndRectangle.gh (Grasshopper 1.0.8)

panel = Panel("10")
pt = ConstructPoint(
    XCoordinate=Slider(43.6, range=-10.5..100),
    YCoordinate=Slider(22.7, range=-10.5..100),
    ZCoordinate=Slider(84.5, range=-10.5..100))
vec = VectorXYZ(XComponent=Slider(10, range=0..10), YComponent=0, ZComponent=0)  # -> Vector, Length
addition = Addition(A=pt, B=vec.Vector)
xy = XYPlane(Origin=Point(0, 0, 0))
rectangle = Rectangle(Plane=xy, XSize=Slider(64, range=0..100), YSize=Slider(64, range=0..100), Radius=Slider(8, range=0..100))  # -> Rectangle, Length
Z = UnitZ(Factor=Slider(14, range=0..100))
srf = Surface(rectangle.Rectangle)
extr = Extrude(Base=srf, Direction=Z)
