# Grasshopper definition RHGeneratePolygonSine.gh (Grasshopper 1.0.8)

python_3_script = Python3Script(
    x_spacing=Slider(41.5, range=0..100),
    radius=Slider(54.1, range=0..100),
    num_pts_peak=Slider(44, range=1..1000),
    num_peaks=Slider(11, range=1..100))  # -> out, a, pt, pts; inputs num_pts_peak: Int32, num_peaks: Int32
# ---------- python_3_script: Python ----------
"""Grasshopper Script"""

import rhinoscriptsyntax as rs
import math

# pts = [] 
# for i in range(0, 300):
#     #pt2 = (x+10, y, z)
#     p = rs.AddPoint(i, radius * math.sin(i), 0)
#     pts.append(p)
#     #print(p)

def generate_sine():
    x_pos = 0
    y_pos = 0 
    z_pos = 0
    pts = []
    base_rad = 2 * math.pi / num_pts_peak
    for i in range(0, num_peaks):
        
        for j in range(0, num_pts_peak):
            z_pos = (i + 1) * j
            pt = (x_pos, radius * math.sin(base_rad * j), z_pos)
            x_pos += x_spacing / num_pts_peak
            rh_pt = rs.AddPoint(pt)
            pts.append(rh_pt)
            print(pt)
    return pts

pts = generate_sine()
# ---------- end python_3_script ----------
panel = Panel(python_3_script.out)
point = Point(python_3_script.pts)
panel_2 = Panel(python_3_script.pts)
xz_plane = XZPlane(Origin=point)
polygon = Polygon(Plane=xz_plane, Radius=Slider(5, range=1..100), Segments=Slider(15, range=1..100), FilletRadius=0)  # -> Polygon, Length
surface = Surface(polygon.Polygon)
unit_y = UnitY(Factor=Slider(45, range=1..100))
extrude = Extrude(Base=surface, Direction=unit_y)

polyline = PolyLine(Vertices=point, Closed=False)
sweep1 = Sweep1(Rail=polyline, Sections=polygon.Polygon, Miter=1)
