# Grasshopper definition RSGenerateCylinders.gh (Grasshopper 1.0.7)

ghpython_script = GhPythonScript(x=Slider(19, range=0..100), y=Slider(10, range=0..50))  # -> out, pts, heights; inputs y: Int32
# ---------- ghpython_script: Python ----------
__author__ = "mrivera-cu"

import rhinoscriptsyntax as rs

import random

print("Hello, world!")
print(x)

ptX = 0
ptY = 0
ptZ = 0

pts = [] 
heights = [] 
for i in range(0, y):
    for j in range(0, y):
        pt = (i*x + ptX, j * x + ptY, ptZ)
        pts.append(rs.AddPoint(pt))
        heights.append(random.randint(0, 100))
# ---------- end ghpython_script ----------
panel = Panel(ghpython_script.out)
unit_z = UnitZ(Factor=ghpython_script.heights)
circle = Circle(Plane=ghpython_script.pts, Radius=Slider(22, range=0..100))
panel_2 = Panel(ghpython_script.heights)
surface = Surface(circle)
extrude = Extrude(Base=surface, Direction=unit_z)
