# Grasshopper definition RSPoint.gh (Grasshopper 1.0.8)
# plug-ins: RhinoCodePluginGH

python_3_script = Python3Script(x=Slider(6, range=0..10), y=Slider(6, range=0..10))  # -> out, a
# ---------- python_3_script: Python ----------
import rhinoscriptsyntax as rs

a = rs.AddPoint((x,y,5))
print(a)
# ---------- end python_3_script ----------
panel = Panel(python_3_script.out)
