# Grasshopper definition RSPointSpiral.gh (Grasshopper 1.0.8)
# plug-ins: RhinoCodePluginGH

spiral_radius = Slider(10, range=1..30)
python_3_script = Python3Script(max_z=Slider(12, range=1..30), spiral_count=Slider(3, range=1..20), r=spiral_radius)  # -> out, points; inputs max_z: Int32, spiral_count: Int32, r: Double
# ---------- python_3_script: Python ----------
__author__ = "mrivera-cu"

import rhinoscriptsyntax as rs

import math 

points = []
spiral_division = 30
z_increment = max_z / (spiral_count * spiral_division)
angle_increment = 360.0 / (spiral_division)
z = 0
a = 0
while (z <= max_z): 
    print(z)
    rads = math.radians(a)
    x = r * math.cos(rads)
    y = r * math.sin(rads)
    p = rs.AddPoint((x, y, z))
    
    # Update z position and increment 
    z += z_increment
    a += angle_increment

    points.append(p)
# ---------- end python_3_script ----------
panel = Panel(python_3_script.points)
polyline = PolyLine(Vertices=python_3_script.points, Closed=False)
