# Grasshopper definition RSPointSpiralScaleMultiple.gh (Grasshopper 1.0.8)
# plug-ins: RhinoCodePluginGH

spiral_radius = Slider(10, range=1..30)
python_3_script = Python3Script(max_z=Slider(12, range=1..30), spiral_count=Slider(3, range=1..20), r=spiral_radius)  # -> out, points; inputs max_z: Int32, spiral_count: Int32, r: Double
# ---------- python_3_script: Python ----------
__author__ = "mrivera-cu"

import rhinoscriptsyntax as rs

import math 

points = []
spiral_division = 30
z_increment = max_z / (spiral_count * spiral_division)
angle_increment = 360.0 / (spiral_division)
z = 0
a = 0
while (z <= max_z): 
    print(z)
    rads = math.radians(a)
    x = r * math.cos(rads)
    y = r * math.sin(rads)
    p = rs.AddPoint((x, y, z))
    
    # Update z position and increment 
    z += z_increment
    a += angle_increment

    points.append(p)
# ---------- end python_3_script ----------
xz_plane = XZPlane(Origin=Point(0, 0, 0))
list_item = ListItem(List=python_3_script.points, Index=0, Wrap=True)
panel = Panel(python_3_script.points)
circle = Circle(Plane=xz_plane, Radius=1)
move = Move(Geometry=circle, Motion=list_item)  # -> Geometry, Transform
polyline = PolyLine(Vertices=python_3_script.points, Closed=False)
number_slider = Slider(3, range=0..10)
construct_domain = ConstructDomain(DomainStart=Slider(0, range=0..50), DomainEnd=Slider(3, range=0..50))
sweep1 = Sweep1(Rail=polyline, Sections=move.Geometry, Miter=1)
cap_holes = CapHoles(Brep=sweep1)
random = Random(Range=construct_domain, Number=number_slider, Seed=Slider(8, range=0..10))
random_2 = Random(Range=construct_domain, Number=number_slider, Seed=Slider(6, range=0..10))
random_3 = Random(Range=construct_domain, Number=number_slider, Seed=Slider(4, range=0..10))
panel_2 = Panel(random_3)
scale_nu = ScaleNU(Geometry=cap_holes, Plane=PlaneXY(0, 0, 0), ScaleX=random_3, ScaleY=random_2, ScaleZ=random)  # -> Geometry, Transform
solid_union = SolidUnion(Breps=scale_nu.Geometry)
