# Grasshopper definition RSPointSpiralSweepMultiple.gh (Grasshopper 1.0.8)
# plug-ins: RhinoCodePluginGH

series = Series(Start=0, Step=1, Count=Slider(3, range=0..10))
max_height_count = Slider(14, range=1..30)
random = Random(Range=Domain(0, 1), Number=1, Seed=series)
multiplication = Multiplication(A=random, B=max_height_count)
number_slider = Slider(12, range=1..30)
max_spiral_count = Slider(8, range=1..30)
spiral_radius = Slider(10, range=1..30)
round = Round(Number=multiplication)  # -> Nearest, Floor, Ceiling
panel = Panel(round.Nearest)
python_3_script = Python3Script(max_z=round.Nearest, spiral_count=max_spiral_count, r=spiral_radius)  # -> out, points; inputs max_z: Int32, spiral_count: Int32, r: Double; disabled
# ---------- python_3_script: Python ----------
__author__ = "mrivera-cu"

import rhinoscriptsyntax as rs

import math 

points = []
spiral_division = 30
z_increment = max_z / (spiral_count * spiral_division)
angle_increment = 360.0 / (spiral_division)
z = 0
a = 0
while (z <= max_z): 
    print(z)
    rads = math.radians(a)
    x = r * math.cos(rads)
    y = r * math.sin(rads)
    p = rs.AddPoint((x, y, z))
    
    # Update z position and increment 
    z += z_increment
    a += angle_increment

    points.append(p)
# ---------- end python_3_script ----------
xz_plane = XZPlane(Origin=Point(0, 0, 0))
circle = Circle(Plane=xz_plane, Radius=1)
list_item = ListItem(List=python_3_script.points, Index=0, Wrap=True)
panel_2 = Panel(python_3_script.points)
move = Move(Geometry=circle, Motion=list_item)  # -> Geometry, Transform
polyline = PolyLine(Vertices=python_3_script.points, Closed=False)
sweep1 = Sweep1(Rail=polyline, Sections=move.Geometry, Miter=1)
bounding_box = BoundingBox(Content=sweep1, Plane=PlaneXY(0, 0, 0))  # -> Box, Box_2
deconstruct_box = DeconstructBox(Box=bounding_box.Box)  # -> Plane, X, Y, Z
flatten_tree = FlattenTree(Tree=deconstruct_box.X, Path="{0}")
maximum = Maximum(A=flatten_tree)
unit_x = UnitX(Factor=maximum)
move_2 = Move(Geometry=sweep1, Motion=unit_x)  # -> Geometry, Transform
