# Grasshopper definition RSSineCurveSweep.gh (Grasshopper 1.0.8)
# plug-ins: RhinoCodePluginGH

# ---- group: Generate waves around circle
python_3_script = Python3Script(
    peak_radius=Slider(10, range=1..50),
    num_peaks=Slider(1, range=0..30),
    points_per_peak=Slider(30, range=0..30),
    x_spacing=Slider(0.5, range=0.1..10))  # -> out, output_pts; inputs num_peaks: Int32, points_per_peak: Int32
# ---------- python_3_script: Python ----------
"""Grasshopper Script"""

import math 
import rhinoscriptsyntax as rs

def generate_points():
    x_pos = 0
    y_pos = 0
    pts = []
    for i in range(0, num_peaks):
        z_pos = 0
        base_rad = 2 * math.pi / (2 * points_per_peak)
        for j in range(0, 2 * points_per_peak):
            # z = r * sin(rads)
            z_pos = peak_radius * math.sin(j * base_rad)
            pt = [x_pos, y_pos, z_pos]
            rh_pt = rs.AddPoint(pt)
            pts.append(rh_pt)
            x_pos += x_spacing
    return pts

output_pts = generate_points()
# ---------- end python_3_script ----------
point = Point(python_3_script.output_pts)
panel = Panel(python_3_script.out)
polyline = PolyLine(Vertices=point, Closed=False)
unit_z = UnitZ(Factor=1)
pi = Pi(Factor=Slider(2, range=0.01..2))
point_2 = Point(Point(0, 0, 0))
line = Line(StartPoint=point_2, EndPoint=unit_z)
construct_domain = ConstructDomain(DomainStart=Slider(0, range=0..100), DomainEnd=pi)

# ---- group: Rotate with Sweep
number_slider = Slider(0.125, range=0..1)
division = Division(A=Slider(2, range=0..10), B=number_slider)
series = Series(Start=Slider(0, range=0..100), Step=number_slider, Count=division)
pi_2 = Pi(Factor=series)
yz_plane = YZPlane(Origin=Point(0, 0, 0))
polygon = Polygon(Plane=yz_plane, Radius=3, Segments=6, FilletRadius=0)  # -> Polygon, Length
rotate = Rotate(Geometry=polyline, Angle=pi_2, Plane=yz_plane)  # -> Geometry, Transform
sweep1 = Sweep1(Rail=rotate.Geometry, Sections=polygon.Polygon, Miter=Slider(1, range=0..2))

# ----
python_3_script_2 = Python3Script(
    num_peaks=Slider(1, range=0..10),
    peak_radius=Slider(12, range=0.1..30),
    x_spacing=Slider(0.6, range=0.1..20),
    points_per_peak=Slider(22, range=1..30))  # -> out, output_pts; inputs num_peaks: Int32, points_per_peak: Int32; same code as python_3_script

# ---- group: Revolve
unit_z_2 = UnitZ(Factor=Slider(8, range=0..100))
revolution = Revolution(Curve=polyline, Axis=line, Domain=construct_domain)
extrude = Extrude(Base=revolution, Direction=unit_z_2)

# ----
point_3 = Point(python_3_script_2.output_pts)
panel_2 = Panel(python_3_script_2.out)
yz_plane_2 = YZPlane(Origin=Point(0, 0, 0))

# ---- group: Normal Sweep
yz_plane_3 = YZPlane(Origin=Point(0, 0, 0))
polygon_2 = Polygon(Plane=yz_plane_3, Radius=3, Segments=6, FilletRadius=0)  # -> Polygon, Length
sweep1_2 = Sweep1(Rail=polyline, Sections=polygon_2.Polygon, Miter=Slider(1, range=0..2))

# ----
polyline_2 = PolyLine(Vertices=point_3, Closed=False)
number_slider_2 = Slider(0.125, range=0..1)
polygon_3 = Polygon(Plane=yz_plane_2, Radius=3, Segments=6, FilletRadius=0)  # -> Polygon, Length
division_2 = Division(A=Slider(2, range=0..10), B=number_slider_2)
unit_z_3 = UnitZ(Factor=1)
pi_3 = Pi(Factor=Slider(2, range=0..2))
series_2 = Series(Start=0, Step=number_slider_2, Count=division_2)
point_4 = Point(Point(0, 0, 0))
construct_domain_2 = ConstructDomain(DomainStart=Slider(0, range=0..100), DomainEnd=pi_3)
sweep1_3 = Sweep1(Rail=polyline_2, Sections=polygon_3.Polygon, Miter=Slider(2, range=0..2))
line_2 = Line(StartPoint=point_4, EndPoint=unit_z_3)

# ---- group: Visualize
unit_x = UnitX(Factor=Slider(46, range=0..100))
negative = Negative(Value=unit_x)
move = Move(Geometry=sweep1_2, Motion=unit_x)  # -> Geometry, Transform
move_2 = Move(Geometry=extrude, Motion=negative)  # -> Geometry, Transform

# ----
pi_4 = Pi(Factor=series_2)
yz_plane_4 = YZPlane(Origin=Point(0, 0, 0))
rotate_2 = Rotate(Geometry=polyline_2, Angle=pi_4, Plane=yz_plane_4)  # -> Geometry, Transform
revolution_2 = Revolution(Curve=polyline_2, Axis=line_2, Domain=construct_domain_2)
unit_z_4 = UnitZ(Factor=Slider(20, range=1..20))
polygon_4 = Polygon(Plane=yz_plane_4, Radius=Slider(2.5, range=0.1..20), Segments=Slider(5, range=3..10), FilletRadius=0)  # -> Polygon, Length
panel_3 = Panel(rotate_2.Geometry)
extrude_2 = Extrude(Base=revolution_2, Direction=unit_z_4)
sweep1_4 = Sweep1(Rail=rotate_2.Geometry, Sections=polygon_4.Polygon, Miter=Slider(1, range=0..2))
