# Grasshopper definition RSTwistingCylindersAndBoxes.gh (Grasshopper 1.0.8)

ghpython_script = GhPythonScript(x=Slider(6, range=0..10), y=Slider(6, range=0..10), minRadius=Slider(5, range=0..70))  # -> out, pts, circles
# ---------- ghpython_script: Python ----------
__author__ = "mrivera-cu"

import rhinoscriptsyntax as rs
from random import random

a = rs.AddPoint((x,y,5))

startX = x
startY = y
startZ = 10

pts = []
circles = []

# Create points
for i in range(0, 10):
    for j in range(0, 10):
        newX = startX + i * 10
        newY = startY + j * 15
        pts.append(rs.AddPoint(newX, newY, startZ))
    

for pt in pts:
    newRadius = minRadius + random() * 20
    circles.append(rs.AddCircle(pt, newRadius))
# ---------- end ghpython_script ----------
surface = Surface(ghpython_script.circles)
panel = Panel(ghpython_script.pts)
panel_2 = Panel(ghpython_script.out)
vector_xyz = VectorXYZ(XComponent=Slider(1, range=0..1), YComponent=Slider(0, range=0..1), ZComponent=Slider(1, range=0..1))  # -> Vector, Length
multiplication = Multiplication(A=vector_xyz.Vector, B=Slider(200, range=0..1000))
xy_plane = XYPlane(Origin=Point(0, 0, 0))
panel_3 = Panel(multiplication)
extrude = Extrude(Base=surface, Direction=multiplication)
cap_holes = CapHoles(Brep=extrude)
unit_x = UnitX(Factor=Slider(-100, range=-100..0))
rectangle = Rectangle(Plane=xy_plane, XSize=Slider(17, range=0..100), YSize=Slider(17, range=0..100), Radius=0)  # -> Rectangle, Length
circle = Circle(Plane=xy_plane, Radius=Slider(17, range=0..100))
solid_union = SolidUnion(Breps=cap_holes)
move = Move(Geometry=[rectangle.Rectangle, circle], Motion=unit_x)  # -> Geometry, Transform

# ---- group: Use Bounding Box to Get Central Axis
bounding_box = BoundingBox(Content=solid_union, Plane=PlaneXY(0, 0, 0))  # -> Box, Box_2
area = Area(Geometry=bounding_box.Box)  # -> Area, Centroid
deconstruct_box = DeconstructBox(Box=bounding_box.Box)  # -> Plane, X, Y, Z
deconstruct_domain = DeconstructDomain(Domain=deconstruct_box.Z)  # -> Start, End
point = Point(area.Centroid)
deconstruct_vector = DeconstructVector(Vector=point)  # -> XComponent, YComponent, ZComponent
relay = Relay()
vector_xyz_2 = VectorXYZ(XComponent=deconstruct_vector.XComponent, YComponent=deconstruct_vector.YComponent, ZComponent=deconstruct_domain.End)  # -> Vector, Length
vector_xyz_3 = VectorXYZ(XComponent=deconstruct_vector.XComponent, YComponent=deconstruct_vector.YComponent, ZComponent=deconstruct_domain.Start)  # -> Vector, Length
line = Line(StartPoint=vector_xyz_3.Vector, EndPoint=vector_xyz_2.Vector)

# ----
area_2 = Area(Geometry=move.Geometry)  # -> Area, Centroid
surface_2 = Surface(move.Geometry)
unit_z = UnitZ(Factor=Slider(88, range=0..100))
extrude_2 = Extrude(Base=surface_2, Direction=unit_z)
addition = Addition(A=unit_z, B=area_2.Centroid)
area_3 = Area(Geometry=extrude_2)  # -> Area, Centroid
point_2 = Point(area_2.Centroid)
point_3 = Point(area_3.Centroid)
line_2 = Line(StartPoint=addition, EndPoint=point_2)
bounding_box_2 = BoundingBox(Content=extrude_2, Plane=PlaneXY(0, 0, 0))  # -> Box, Box_2
deconstruct_box_2 = DeconstructBox(Box=bounding_box_2.Box)  # -> Plane, X, Y, Z
twist = Twist(Geometry=extrude_2, Axis=line_2, Angle=Slider(10.423, range=0..314.159), Infinite=False, Rigid=False)
deconstruct_domain_2 = DeconstructDomain(Domain=deconstruct_box_2.Z)  # -> Start, End
panel_4 = Panel(twist)
brep_join = BrepJoin(Breps=twist)  # -> Breps, Closed
panel_5 = Panel(deconstruct_domain_2.End)
geometry = Geometry(solid_union)
twist_2 = Twist(Geometry=geometry, Axis=line, Angle=Slider(3.029, range=0..12.566), Infinite=False, Rigid=False)
