# Grasshopper definition GcodeMoveCommand.gh (Grasshopper 1.0.7)

construct_point = ConstructPoint(XCoordinate=Slider(5, range=-10..30), YCoordinate=Slider(1, range=-10..30), ZCoordinate=Slider(0, range=-10..30))
construct_point_2 = ConstructPoint(XCoordinate=Slider(30, range=-10..30), YCoordinate=Slider(1, range=-10..30), ZCoordinate=Slider(0, range=-10..30))
travel_feed_rate = Panel("1000")
extrusion_feed_rate = Panel("600")
line = Line(StartPoint=construct_point, EndPoint=construct_point_2)
line_2 = Line(flatten(line))
ghpython_script = GhPythonScript(lines=line_2, travel_feed_rate=travel_feed_rate, extrusion_feed_rate=extrusion_feed_rate)  # -> out, gcode_output; inputs lines: list of Line
# ---------- ghpython_script: Python ----------
__author__ = "mrivera-cu"

import rhinoscriptsyntax as rs


# CONSTANTS USED BELOW

# GCODE COMMANDS
COMMAND_MOVE = "G1"

# GCODE PARAM Names
PARAM_X = "X"
PARAM_Y = "Y"
PARAM_Z = "Z"
PARAM_E = "E"
PARAM_F = "F"

# Separates params in a command
PARAM_DELIMITER = " "

# Separates commands
COMMAND_DELIMITER = "\n"

# Formatter for param values
NUM_FORMAT = "{value:.3f}"
    
# creates a string consisting of a G1 move command and 
# any associated parameters
def gcode_move(current_pos, next_pos, feed_rate=None):
    params = [COMMAND_MOVE]
    # Compare X position and see if we have to move
    if (current_pos[0] != next_pos[0]):
        # we have a different x position so
        # add as a param
        x_param_value = NUM_FORMAT.format(value=next_pos[0])
        x_param_str = PARAM_X + x_param_value
        params.append(x_param_str)
    
    # Compare Y 
    if (current_pos[1] != next_pos[1]):
        # we have a different y position so
        # add as a param
        y_param_value = NUM_FORMAT.format(value=next_pos[1])
        y_param_str = PARAM_Y + y_param_value
        params.append(y_param_str)
    
        # Compare Z
    if (current_pos[2] != next_pos[2]):
        # we have a different z position so
        # add as a param
        z_param_value = NUM_FORMAT.format(value=next_pos[2])
        z_param_str = PARAM_Z + z_param_value
        params.append(z_param_str)
    
    if (feed_rate is not None):
        feed_rate_value = NUM_FORMAT.format(value=feed_rate)
        feed_rate_str = PARAM_F + feed_rate_value
        params.append(feed_rate_str)
    
    # Make the command from the parameters
    move_command = " ".join(params)
    # Remove excess whitespace on ends
    move_commnad = move_command.strip(" ")
    return move_command
    
# Here's the main procedure that uses the functions above

line = lines[0]
origin = [0, 0, 0]
start_pt = line[0]
end_pt = line[1]

first_move = gcode_move(origin, start_pt, feed_rate=travel_feed_rate)
second_move = gcode_move(start_pt, end_pt, feed_rate=extrusion_feed_rate)

gcode_output = COMMAND_DELIMITER.join([first_move, second_move])
print(gcode_output)
# ---------- end ghpython_script ----------
panel = Panel(ghpython_script.gcode_output)
