# Grasshopper definition GcodeMoveCommandMultiple.gh (Grasshopper 1.0.7)

construct_point = ConstructPoint(XCoordinate=Slider(10, range=-10..30), YCoordinate=Slider(10, range=-10..30), ZCoordinate=Slider(1, range=-10..30))
construct_point_2 = ConstructPoint(XCoordinate=Slider(10, range=-10..30), YCoordinate=Slider(20, range=-10..30), ZCoordinate=Slider(1, range=-10..30))
construct_point_3 = ConstructPoint(XCoordinate=Slider(5, range=-10..30), YCoordinate=Slider(1, range=-10..30), ZCoordinate=Slider(0, range=-10..30))
construct_point_4 = ConstructPoint(XCoordinate=Slider(30, range=-10..30), YCoordinate=Slider(1, range=-10..30), ZCoordinate=Slider(0, range=-10..30))
extrusion_feed_rate = Panel("600")
travel_feed_rate = Panel("1000")
line = Line(StartPoint=construct_point, EndPoint=construct_point_2)
line_2 = Line(StartPoint=construct_point_3, EndPoint=construct_point_4)
line_3 = Line(line)
line_4 = Line(line_2)
line_5 = Line(flatten([line_4, line_3]))
ghpython_script = GhPythonScript(lines=line_5, travel_feed_rate=travel_feed_rate, extrusion_feed_rate=extrusion_feed_rate)  # -> out, gcode_output; inputs lines: list of Line
# ---------- ghpython_script: Python ----------
__author__ = "mrivera-cu"

import rhinoscriptsyntax as rs


# CONSTANTS USED BELOW

# GCODE COMMANDS
COMMAND_MOVE = "G1"

# GCODE PARAM Names
PARAM_X = "X"
PARAM_Y = "Y"
PARAM_Z = "Z"
PARAM_E = "E"
PARAM_F = "F"

# Separates params in a command
PARAM_DELIMITER = " "

# Separates commands
COMMAND_DELIMITER = "\n"

# Formatter for param values
NUM_FORMAT = "{value:.3f}"

# Returns true if all the coordinates are the same pt
def is_same_pt(pt1, pt2):
    return (pt1[0] == pt2[0]) and (pt1[1] == pt2[1]) and (pt1[2] == pt2[2])
    
# creates a string consisting of a G1 move command and 
# any associated parameters
def gcode_move(current_pos, next_pos, feed_rate=None):
    params = [COMMAND_MOVE]
    # Compare X position and see if we have to move
    if (current_pos[0] != next_pos[0]):
        # we have a different x position so
        # add as a param
        x_param_value = NUM_FORMAT.format(value=next_pos[0])
        x_param_str = PARAM_X + x_param_value
        params.append(x_param_str)
    
    # Compare Y 
    if (current_pos[1] != next_pos[1]):
        # we have a different y position so
        # add as a param
        y_param_value = NUM_FORMAT.format(value=next_pos[1])
        y_param_str = PARAM_Y + y_param_value
        params.append(y_param_str)
    
    # Compare Z
    if (current_pos[2] != next_pos[2]):
        # we have a different z position so
        # add as a param
        z_param_value = NUM_FORMAT.format(value=next_pos[2])
        z_param_str = PARAM_Z + z_param_value
        params.append(z_param_str)
    
    if (feed_rate is not None):
        feed_rate_value = NUM_FORMAT.format(value=feed_rate)
        feed_rate_str = PARAM_F + feed_rate_value
        params.append(feed_rate_str)
    
    # Make the command from the parameters
    move_command = " ".join(params)
    # Remove excess whitespace on ends
    move_commnad = move_command.strip(" ")
    return move_command
    
# Here's the main procedure that uses the functions above

line = lines[0]
origin = [0, 0, 0]

gcode_lines = []

# start at the origin
last_pt = origin

# Now move to the line segments
for i in range(0, len(lines)):
    # Get pts of the line segment
    line = lines[i]
    line_start_pt = line[0]
    line_end_pt = line[1]
    
    # see if we are starting at the start point, if not
    # we need to move/travel to it
    # This case would happen when moving from the origin (last_pt = origin)
    # or if line segments are not a part of a continous curve
    if not is_same_pt(last_pt, line_start_pt):
        # first move from origin to starting point
        move_to_first_point_command = gcode_move(last_pt, line_start_pt, feed_rate=travel_feed_rate)
        # append command
        gcode_lines.append(move_to_first_point_command)
    
    # Now do the move along the line segment
    move_across_line_command = gcode_move(line_start_pt, line_end_pt, feed_rate=extrusion_feed_rate)

    # Append the move
    gcode_lines.append(move_across_line_command)
    
    # Now make the end of the line segment be the last_pt we were at
    last_pt = line_end_pt


gcode_output = COMMAND_DELIMITER.join(gcode_lines)
print(gcode_output)
# ---------- end ghpython_script ----------
panel = Panel(ghpython_script.gcode_output)
