# Grasshopper definition Points-Simulation.gh (Grasshopper 1.0.8)

point = Point(Point(-14.52015917, 16.74012255, 51.04563258))
# Pendulum Simulation with Springs
point_2 = Point(Point(23.28424531, -3.788508134, 51.04563258))

# ---- group: Gravity Goal
negative = Negative(Value=Slider(0.001, range=0..0.01))
vector_xyz = VectorXYZ(XComponent=0, YComponent=0, ZComponent=negative)  # -> Vector, Length
load = Load(Point=point_2, ForceVector=vector_xyz.Vector, Weighting=1)

# ---- group: Fix distance between points with spring
line = Line(StartPoint=point_2, EndPoint=point)
length_line = LengthLine(Line=line, Strength=10)

# ----
anchor = Anchor(Point=point, Target=point, Strength=10000)

# ---- group: The ground goal
floor = Floor(Strength=1)

# ----
entwine = Entwine(Branch00=load, Branch01=floor, Branch02=length_line, Branch03=anchor, FlattenInputs=True)

# ---- group: Trigger an animation frame
trigger = Trigger(Interval=10, TimerInterval=10, Target=random)
construct_domain = ConstructDomain(DomainStart=Slider(0.1, range=0..0.1), DomainEnd=Slider(1, range=0..1))
animate = BooleanToggle(True)
random = Random(Range=construct_domain, Number=1, Seed=2)
gate_and = GateAnd(A=animate, B=random)

# ---- group: Solve Default (converges too fast for simple geometry)
solver = Solver(GoalObjects=entwine, Reset=Button(), Threshold=1e-15, Tolerance=0.0001, On=Toggle(True))  # -> I, V, O; disabled

# ---- group: Step Solve / Animate (works better for smaller demos)
stepsolver = StepSolver(
    GoalObjects=entwine,
    Tolerance=0.0001,
    Momentum=Toggle(True),
    Damping=Slider(0.999, range=0..1),
    SubIterations=Slider(7, range=0..1000),
    Animate=gate_and)  # -> I, V, O
