# Grasshopper definition SimulateBallDrop.gh (Grasshopper 1.0.7)
# plug-ins: Kangaroo2 Components, Pancake

vector_xyz = VectorXYZ(XComponent=Slider(0, range=0..100), YComponent=Slider(0, range=0..100), ZComponent=Slider(31, range=0..100))  # -> Vector, Length
sphere = Sphere(Base=PlaneXY(0, 0, 0), Radius=Slider(10, range=0..30))
move = Move(Geometry=sphere, Motion=vector_xyz.Vector)  # -> Geometry, Transform
mesh_brep = MeshBrep(
    Brep=move.Geometry,
    Settings={GridMaxCount=0, GridMinCount=16, JaggedSeams=False, MaxEdgeLength=0, MinEdgeLength=0.0001, MinTolerance=0, Refine=True, RefineAngle=0, RelativeTolerance=0.65, SimplePlanes=True, Tolerance=0})
vertexloads = VertexLoads(Mesh=mesh_brep, Strength=Slider(-0.1, range=-100..0))
true_only_button = TrueOnlyButton(LastSaveLocalization="neutral,N")
true_only_button_2 = TrueOnlyButton(LastSaveLocalization="neutral,N")
entwine = Entwine(Branch00=vertexloads, FlattenInputs=True)
solver = Solver(GoalObjects=entwine, Reset=true_only_button_2, Threshold=1e-15, Tolerance=0.0001, On=Toggle(True))  # -> I, V, O
stepsolver = StepSolver(
    GoalObjects=vertexloads,
    Tolerance=0.0001,
    Momentum=False,
    Damping=0.99,
    SubIterations=Slider(0, range=0..100),
    Animate=Toggle(False))  # -> I, V, O
