# Grasshopper definition SimulateJelloFloor.gh (Grasshopper 1.0.7)
# plug-ins: Kangaroo2 Components

# ---- group: Create Cube and Spring Segment Points
size_of_jello_cube_s_dimensions = Slider(5, range=0..30)
unit_z = UnitZ(Factor=Slider(15, range=0..30))
integer = Integer(size_of_jello_cube_s_dimensions)
create_jello_w_spring_points = GhPythonScript(dim=integer, initialPos=unit_z)  # -> out, points, startPtsSprings, endPtsSprings
# ---------- create_jello_w_spring_points: Python ----------
__author__ = "mrivera-cu"

import rhinoscriptsyntax as rs

DIM = dim
points = []
segments = []
initalX = initialPos[0]
initalY = initialPos[1]
initalZ = initialPos[2]

def indexFromPositionDim(i, j, k):
    return i + DIM * (j + k * DIM)

# make points
for i in range(0, DIM):
    for j in range(0, DIM):
        for k in range(0, DIM):
            #pt = rs.AddPoint(i,j,k)
            pt = (i + initalX, j + initalY, k + initalZ)
            points.append(rs.AddPoint(pt))
        
# make spring segments 
JDM1 = DIM - 1
for i in range(0, DIM):
    for j in range(0, DIM):
        for k in range(0, DIM):
            index = indexFromPositionDim(i, j, k)
            p1 = points[index]
            index = indexFromPositionDim(i, j, k)
            if (i < JDM1):
                segments.append([p1, points[indexFromPositionDim(i + 1, j, k)]])
            if (j < JDM1):
                segments.append([p1, points[ indexFromPositionDim(i, j + 1, k)]])
            if (k < JDM1):
                segments.append([p1, points[ indexFromPositionDim(i, j, k + 1)]])

            # Add Bend Springs
            if (i < DIM - 2): 
                segments.append([p1, points[ indexFromPositionDim(i + 2, j, k)]])
            if (j < DIM - 2): 
                segments.append([p1, points[ indexFromPositionDim(i, j + 2, k)]])
            if (k < DIM - 2): 
                segments.append([p1, points[ indexFromPositionDim(i, j, k + 2)]])

            # Add Bend Springs
            if (i < DIM - 2): 
                segments.append([p1, points[ indexFromPositionDim(i + 2, j, k)]])
            if (j < DIM - 2): 
                segments.append([p1, points[ indexFromPositionDim(i, j + 2, k)]])
            if (k < DIM - 2): 
                segments.append([p1, points[ indexFromPositionDim(i, j, k + 2)]])
                
            # Add Shear Springs
            if (i < JDM1 and j < JDM1):
                segments.append([p1, points[ indexFromPositionDim(i + 1, j + 1, k)]])
                segments.append([points[indexFromPositionDim(i+1, j , k)], points[indexFromPositionDim(i, j+1 , k)]])
             
            if (i < JDM1 and k < JDM1):
                segments.append([p1, points[ indexFromPositionDim(i + 1, j, k + 1)]])
                segments.append([points[indexFromPositionDim(i + 1, j , k)], points[indexFromPositionDim(i, j, k + 1)]])
            
            if (j < JDM1 and k < JDM1):
                segments.append([p1, points[indexFromPositionDim(i, j + 1, k + 1)]])
                segments.append([points[indexFromPositionDim(i, j, k+1)], points[indexFromPositionDim(i, j+1 , k)]])

            if (i < JDM1 and j < JDM1 and k < JDM1):
                segments.append([p1, points[indexFromPositionDim(i+1, j+1, k+1)]])
                
            if (i > 0 and j < JDM1 and k < JDM1):
                segments.append([p1, points[ indexFromPositionDim(i-1, j+1, k+1)]])

            if (i < JDM1 and j > 0  and k < JDM1):
                segments.append([p1, points[ indexFromPositionDim(i+1, j-1, k+1)]])


            if (i > 0 and j > 0 and k < JDM1):
                segments.append([p1, points[indexFromPositionDim(i-1, j-1, k+1)]])
      
startPtsSprings = []
endPtsSprings = []
for i in range(0, len(segments)):
    l = segments[i]
    pt1 = rs.AddPoint(l[0])
    pt2 = rs.AddPoint(l[1])
    startPtsSprings.append(pt1)
    endPtsSprings.append(pt2)
# ---------- end create_jello_w_spring_points ----------
point = Point(create_jello_w_spring_points.points)
point_2 = Point(create_jello_w_spring_points.startPtsSprings)
point_3 = Point(create_jello_w_spring_points.endPtsSprings)

# ---- group: Floor
# Simulation Goals
number_slider = Slider(1000, range=0..1000)
floor = Floor(Strength=number_slider)

# ---- group: Gravity
unit_z_2 = UnitZ(Factor=Slider(-9.8, range=-9.8..0))
load = Load(Point=point, ForceVector=unit_z_2, Weighting=1)

# ---- group: Create Springs
line = Line(StartPoint=point_2, EndPoint=point_3)
length_line = LengthLine(Line=line, Strength=Slider(80, range=0..1000000))

# ---- group: THE GEOMETRY TO SHOW
show = Show(G=point)

# ---- group: COMBINE ALL GOALS
entwine = Entwine(Branch00=show, Branch01=floor, Branch02=load, Branch03=length_line, FlattenInputs=True)

# ---- group: RUN SIMULATION
bouncysolver = BouncySolver(
    GoalObjects=simplify(entwine),
    Reset=Button(),
    Threshold=1e-15,
    Tolerance=0.0001,
    Damping=Slider(0.989, range=0..1),
    Iterations=Slider(1, range=0..20),
    On=Toggle(False))  # -> I, V, O
explode_tree = ExplodeTree(Data=bouncysolver.O)  # -> Branch0, Branch1
output_mesh = Geometry(explode_tree.Branch0)

# ----
dotdisplay = DotDisplay(Point=bouncysolver.V)
